# Dynamo graph ExcelGenericComponentParams.dyn (Dynamo 1.0.0.1180)

# group: EXCEL INPUTS
excel_file_path = Filename(".\Excel2Revit.xlsx")
excel_sheet = CodeBlock { "Sheet1"; }

# group: REVIT INPUTS
categories = Categories("Levels")
parameter_name = CodeBlock { "Elevation"; }

# group: READ FROM EXCEL
fromPath = FileObject(excel_file_path)  # "File.FromPath"
readFromFile = Excel.ReadFromFile(file=fromPath, sheetName=excel_sheet)
deconstruct = List.Deconstruct()
map = List.Map(list=readFromFile, f_x=deconstruct.rest)
flatten = Flatten(map)
string_fractional_feet_to = Custom[String&Fractional Feet To Decimal](String=flatten)  # Converts Fractional Feet To Decima Feet
map_2 = List.Map(list=readFromFile, f_x=deconstruct.first)

watch = Watch(string_fractional_feet_to)
watch_2 = Watch(map_2)

# group: GET & UPDATE EXISTING LEVEL NAMES TO MATCH EXCEL NAMES
all_elements_of_category = ElementsOfCategory(categories)
watch_3 = Watch(all_elements_of_category)
getParameterValueByName = Element.GetParameterValueByName(element=all_elements_of_category, parameterName=parameter_name)
code_block = CodeBlock { 6; }
round = Math.Round(number=getParameterValueByName, digits=code_block)
firstIndexOf = List.FirstIndexOf(list=watch, item=round)
code_block_2 = CodeBlock(x=firstIndexOf) { x>-1; }
filterByBoolMask = List.FilterByBoolMask(list=all_elements_of_category, mask=code_block_2)
levels_that_overlap_with_excel = Watch(filterByBoolMask.in)
code_block_3 = CodeBlock { "Name"; }
filterByBoolMask_2 = List.FilterByBoolMask(list=firstIndexOf, mask=code_block_2)
getItemAtIndex = List.GetItemAtIndex(list=watch_2, index=filterByBoolMask_2.in)
setParameterByName = Element.SetParameterByName(element=levels_that_overlap_with_excel, parameterName=code_block_3, value=getItemAtIndex)
levels_not_in_excel = Watch(filterByBoolMask.out)

# group: WRITE TO EXCEL
code_block_4 = CodeBlock { 0; 0; }
name = Level.Name(all_elements_of_category)
elevation = Level.Elevation(all_elements_of_category)
decimalfeet_to_fractional_string = Custom[DecimalFeet To Fractional String](double=elevation)  # Converts Fractional Feet To Decima Feet
create = List.Create(name, decimalfeet_to_fractional_string)
transpose = List.Transpose(create)
string_from_object = FromObject()
map_3 = List.Map(list=transpose, f_x=string_from_object)
code_block_5 = CodeBlock { true; }
writeToFile = Excel.WriteToFile(filePath=excel_file_path, sheetName=excel_sheet, startRow=code_block_4.out0, startCol=code_block_4.out1, data=map_3, overWrite=code_block_5)
watch_4 = Watch(decimalfeet_to_fractional_string)

# group: CREATE NEW ELEVATIONS
removeItemAtIndex = List.RemoveItemAtIndex(list=watch, indices=filterByBoolMask_2.in)
byElevation = Level.ByElevation(removeItemAtIndex)
removeItemAtIndex_2 = List.RemoveItemAtIndex(list=map_2, indices=filterByBoolMask_2.in)
setParameterByName_2 = Element.SetParameterByName(element=byElevation, parameterName=code_block_3, value=removeItemAtIndex_2)
