# Dynamo graph ExcelLevels.dyn (Dynamo 0.9.2.4472)

file_path = Filename("D:\_DEMO_DATASETS\_DYNAMO\Excel2Levels\Excel2Revit.xlsx")
code_block = CodeBlock { "Sheet1"; }

# group: READ FROM EXCEL
fromPath = FileObject(file_path)  # "File.FromPath"
readFromFile = Excel.ReadFromFile(file=fromPath, sheetName=code_block)
deconstruct = List.Deconstruct()
map = List.Map(list=readFromFile, f_x=deconstruct.rest)
flatten = Flatten(map)
string_fractional_feet_to = Python(IN[0]=flatten)  # "String & Fractional Feet to Decimal Feet"
# ---------- string_fractional_feet_to.python (37 lines) ----------
import clr
import re
clr.AddReference('ProtoGeometry')
from Autodesk.DesignScript.Geometry import *

# FUNCTIONS

def convert2DecimalFeet(strFtInches):
	feet = strFtInches.split("'")[0]
	inches = strFtInches.split("'")[1].split("\"")[0]
	return int(feet)+float(re.sub('[-]','', inches))/12
	
def convert2DecimalFt(strFtInches):
	feet = strFtInches.split("'")[0]
	inches = strFtInches.split("'")[1].split("\"")[0]
	if('/' in inches):
		wholeInches = inches.split(" ")[0]
		wholeInches = re.sub('[-]', '', wholeInches)
		fractionalInches = inches.split(" ")[1]
		numerator = fractionalInches.split("/")[0]
		denominator = fractionalInches.split("/")[1]
		decimalInches = int(wholeInches) + float(numerator)/float(denominator)
		return int(feet) + decimalInches/12
		
	else:
		return int(feet)+float(re.sub('[-]','', inches))/12

#The inputs to this node will be stored as a list in the IN variables.
dataEnteringNode = IN

convertedValues = []
for len in IN[0]:
	#convertedValues.append(convert2DecimalFeet(len))
	convertedValues.append(convert2DecimalFt(len))

#Assign your output to the OUT variable.
OUT = convertedValues
# ----------------------------------------
map_2 = List.Map(list=readFromFile, f_x=deconstruct.first)
watch = Watch(map_2)

watch_2 = Watch(string_fractional_feet_to)

# group: GET & UPDATE EXISTING LEVEL NAMES TO MATCH EXCEL NAMES
categories = Categories("Levels")
all_elements_of_category = ElementsOfCategory(categories)
watch_3 = Watch(all_elements_of_category)
elevation = Level.Elevation(all_elements_of_category)
code_block_2 = CodeBlock { 6; }
round = Math.Round(number=elevation, digits=code_block_2)
firstIndexOf = List.FirstIndexOf(list=watch_2, item=round)
code_block_3 = CodeBlock(x=firstIndexOf) { x>-1; }
filterByBoolMask = List.FilterByBoolMask(list=all_elements_of_category, mask=code_block_3)
levels_that_overlap_with_excel = Watch(filterByBoolMask.in)
code_block_4 = CodeBlock { "Name"; }
filterByBoolMask_2 = List.FilterByBoolMask(list=firstIndexOf, mask=code_block_3)
getItemAtIndex = List.GetItemAtIndex(list=watch, index=filterByBoolMask_2.in)
setParameterByName = Element.SetParameterByName(element=levels_that_overlap_with_excel, parameterName=code_block_4, value=getItemAtIndex)
levels_not_in_excel = Watch(filterByBoolMask.out)

# group: WRITE TO EXCEL
code_block_5 = CodeBlock { 0; 0; }
name = Level.Name(all_elements_of_category)
elevation_2 = Level.Elevation(all_elements_of_category)
decimal_feet_to_fractional_feet = Python(IN[0]=elevation_2)  # "Decimal Feet To Fractional Feet-Inches"
# ---------- decimal_feet_to_fractional_feet.python (58 lines) ----------
import clr
clr.AddReference('ProtoGeometry')
from Autodesk.DesignScript.Geometry import *

# PRECISION DICTIONARY - GLOBAL
# p1b32 = precision of 1 / 32... and so on
pdict = {'p1b2':2, 'p1b4':4, 'p1b8':8, 'p1b16':16, 'p1b32':32}

# FUNCTIONS

def convert2DecimalFeet(strFtInches):
	feet = strFtInches.split("'")[0]
	inches = str(strFtInches-int(strFtInches))[1:]
	return int(feet)+float(re.sub('[-]','', inches))/12
	
def convert2FractionalInches(decimalFeet, precision):
	#inches = str(decimalFeet-int(decimalFeet))[1:]
	inches = str(decimalFeet).split(".")[1]
	
	if(float(inches)==0):
		return 0
		
	inches = float(inches)*12
		
	return inches
	
def convert2FractionalFeetInches(decimalFeet, precision):
	feet = str(decimalFeet).split(".")[0]
	inches = round((decimalFeet - int(feet)),8)*12
	wholeInches = str(abs(inches)).split(".")[0]
	fractionalInches = abs(inches - int(wholeInches))
	
	fractionalNumerator = fractionalInches*precision
	numerator = int(fractionalNumerator)
	
	while(numerator%2==0 and precision > 2):
		numerator = int(numerator/2)
		precision = precision/2
	
	returnVal = ""
	if(numerator!=0):
		fraction = str(numerator) +"/"+str(precision)
		returnVal = str(feet)+"\'-"+ str(wholeInches) + " " + str(fraction)+"\""
	else:
		returnVal = str(feet)+"\'-"+ str(wholeInches)+"\""
	
	return returnVal
	

#The inputs to this node will be stored as a list in the IN variables.
dataEnteringNode = IN

convertedValues = []
for len in IN[0]:
	convertedValues.append(convert2FractionalFeetInches(len, pdict['p1b32']))
	
#Assign your output to the OUT variable.
OUT = convertedValues
# ----------------------------------------
create = List.Create(name, decimal_feet_to_fractional_feet)
transpose = List.Transpose(create)
string_from_object = FromObject()
map_3 = List.Map(list=transpose, f_x=string_from_object)
code_block_6 = CodeBlock { true; }
writeToFile = Excel.WriteToFile(filePath=file_path, sheetName=code_block, startRow=code_block_5.out0, startCol=code_block_5.out1, data=map_3, overWrite=code_block_6)
watch_4 = Watch(decimal_feet_to_fractional_feet)

# group: CREATE NEW ELEVATIONS
removeItemAtIndex = List.RemoveItemAtIndex(list=watch_2, indices=filterByBoolMask_2.in)
byElevation = Level.ByElevation(removeItemAtIndex)
removeItemAtIndex_2 = List.RemoveItemAtIndex(list=map_2, indices=filterByBoolMask_2.in)
setParameterByName_2 = Element.SetParameterByName(element=byElevation, parameterName=code_block_4, value=removeItemAtIndex_2)
